# Grasshopper definition ArmGeometryAnalysis.gh (Grasshopper 1.0.4)

llx = LineLine()  # -> ParamA, ParamB, PointA, PointB
ccx = CurveCurve()  # -> Points, ParamsA, ParamsB
pt = Point(<point referenced from the Rhino model>)
pt_2 = Point(<point referenced from the Rhino model>)
number_slider = Slider(0.7, range=0..1)
yz = YZPlane(Origin=pt_2)
line = Line(Line((0, 17.43762733, -4.220226823), (0, 17.70465981, -4.685550264)))
line_2 = Line(Line((0, 17.43762733, -3.918226823), (0, 17.88506995, -4.214245999)))
rotate = Rotate(Geometry=line_2, Angle=Slider(-0.011, range=-0.1..1.5), Plane=yz)  # -> Geometry, Transform
end = EndPoints(Curve=rotate.Geometry)  # -> Start, End
end_2 = EndPoints(Curve=line)  # -> Start, End
yz_2 = YZPlane(Origin=end_2.End)
yz_3 = YZPlane(Origin=end.End)
cir = Circle(Plane=yz_2, Radius=number_slider)
cir_2 = Circle(Plane=yz_3, Radius=number_slider)
ccx_2 = CurveCurve(CurveA=cir_2, CurveB=cir)  # -> Points, ParamsA, ParamsB
item = ListItem(List=ccx_2.Points, Index=1, Wrap=True)
yz_4 = YZPlane(Origin=item)
ln = Line(StartPoint=end_2.End, EndPoint=item)
ln_2 = Line(StartPoint=end.End, EndPoint=item)
rotate_2 = Rotate(Geometry=ln_2, Angle=3.141592654, Plane=yz_4)  # -> Geometry, Transform
rotate_3 = Rotate(Geometry=ln, Angle=3.141592654, Plane=yz_4)  # -> Geometry, Transform
