# Grasshopper definition gripping.gh (Grasshopper 1.0.4)

pt = Point([<point referenced from the Rhino model> x8])
pt_2 = Point(<point referenced from the Rhino model>)
pt_3 = Point([<point referenced from the Rhino model> x8])
pt_4 = Point(<point referenced from the Rhino model>)
pt_5 = ConstructPoint(XCoordinate=0, YCoordinate=0, ZCoordinate=0)
ln = Line(StartPoint=pt_4, EndPoint=pt_2)
ln_2 = Line(StartPoint=pt_3, EndPoint=pt)
lnpt = LinePt(Line=ln_2, Point=pt_5)
lnpt_2 = LinePt(Line=ln, Point=pt_5)
geo = Geometry(<brep referenced from the Rhino model>)
orient = Orient(Geometry=geo, Source=lnpt_2, Target=lnpt)  # -> Geometry, Transform
item = ListItem(List=orient.Geometry, Index=Slider(7, range=0..7), Wrap=True)
